% Simulink data dictionary appKnbSwt.sldd

Knb_Thresh_Pc_Pt = Simulink.Parameter(20, StorageClass="ExportToFile", HeaderFile="appKnbSwt_Param.h", DefinitionFile="appKnbSwt_Param.c", Owner="appKnbSwt", DataType="uint8")
ADC_MAX = Simulink.Parameter(1023, StorageClass="Define", HeaderFile="appKnbSwt_Param.h", DataType="uint16")
PCT_MAX = Simulink.Parameter(100, StorageClass="Define", HeaderFile="appKnbSwt_Param.h", DataType="uint8", Min=0, Max=100, Unit="%")
DT_Ratio = Simulink.NumericType(DataTypeMode="Fixed-point: slope and bias scaling", SignednessBool=false, WordLength=16, FixedExponent=-10, SlopeAdjustmentFactor=1.000978)
Knb_Hyst_Pc_Pt = Simulink.Parameter(5, StorageClass="ExportToFile", HeaderFile="appKnbSwt_Param.h", DefinitionFile="appKnbSwt_Param.c", Owner="appKnbSwt", DataType="uint8")
OUT_Led1_B = Simulink.Signal(InitialValue="0", StorageClass="ExportToFile", HeaderFile="appKnbSwt_Intfc.h", DefinitionFile="appKnbSwt_Intfc.c", Owner="appKnbSwt", DataType="boolean", Min=0, Max=1)
IN_KnbVal_Z = Simulink.Signal(InitialValue="0", StorageClass="ExportToFile", HeaderFile="appKnbSwt_Intfc.h", DefinitionFile="appKnbSwt_Intfc.c", Owner="appKnbSwt", DataType="uint16", Min=0, Max=1023)